# Grasshopper definition 20210131_audiotests.gh (Grasshopper 1.0.7)
# plug-ins: Firefly.X

# ---- group: loftedAudio
sound_capture = SoundCapture(TimePeriod=Slider(0.02, range=0..0.1), StartStopSoundCapture=Toggle(True))  # -> WavePressureSamplesFromLeftChannel, WavePressureSamplesFromRightChannel, Volume
trigger = Trigger(Interval=20, TimerInterval=20, Target=sound_capture)
data_recorder = DataRecorder(sound_capture.Volume, DataLimit=100, RecordData=True)
scalefactor = Slider(5, range=0..50)
panel = Panel(data_recorder)
baseradius = Slider(15, range=0..100)
baseradius_2 = Slider(10, range=0..100)
multiplication = Multiplication(A=panel, B=scalefactor)
samplesize = Slider(100, range=0..100)
step = Slider(0.5, range=0..10)
subtraction = Subtraction(A=baseradius, B=multiplication)
addition = Addition(A=multiplication, B=baseradius_2)
series = Series(Start=0, Step=step, Count=samplesize)
circle = Circle(Plane=PlaneXY(0, 0, 0), Radius=addition)
unit_z = UnitZ(Factor=series)
move = Move(Geometry=circle, Motion=unit_z)  # -> Geometry, Transform
loft = Loft(Curves=move.Geometry, Options={Adjust=False, Closed=False, LoftEnds=0, LoftSimp=0, LoftType=0, Rebuild=10, Refit=0.01})

# ---- group: circle viz
minradius = Slider(2, range=0..10)
step_2 = Slider(2, range=0..10)
numcircles = Slider(100, range=0..500)
number_slider = Slider(0.02, range=0..0.1)
boolean_toggle = BooleanToggle(False)
series_2 = Series(Start=minradius, Step=step_2, Count=numcircles)
trigger_2 = Trigger(Interval=20, TimerInterval=20)
circle_2 = Circle(Plane=PlaneXY(0, 0, 0), Radius=series_2)
data_recorder_2 = DataRecorder(DataLimit=100, RecordData=True)
scalefactor_2 = Slider(30, range=0..50)
panel_2 = Panel(data_recorder_2)
multiplication_2 = Multiplication(A=panel_2, B=scalefactor_2)
unit_z_2 = UnitZ(Factor=multiplication_2)
move_2 = Move(Geometry=reverse(circle_2), Motion=unit_z_2)  # -> Geometry, Transform
