# Grasshopper definition simpleCone.gh (Grasshopper 1.0.7)

h = Slider(100, range=1..200)
R = Slider(45, range=1..100)
r = Slider(15, range=1..50)
unit_z = UnitZ(Factor=h)
circle = Circle(Plane=PlaneXY(0, 0, 0), Radius=R)
circle_2 = Circle(Plane=PlaneXY(0, 0, 0), Radius=r)
move = Move(Geometry=circle, Motion=unit_z)  # -> Geometry, Transform
thickness = Slider(4, range=0..25)
loft = Loft(
    Curves=[move.Geometry, circle_2],
    Options={Adjust=False, Closed=False, LoftEnds=0, LoftSimp=0, LoftType=0, Rebuild=10, Refit=0.01})
offset_surface = OffsetSurface(Surface=loft, Distance=thickness, Retrim=True)
cap_holes = CapHoles(Brep=[offset_surface, loft])
